# Grasshopper definition youtrack.gh (Grasshopper 1.0.4)
# plug-ins: Human UI, YouTrack

# ---- group: Input
# is required for: RH-33864
# subsystem: {Licensing and Validation}
panel = Panel("MR")
panel_2 = Panel("subsystem: Annotation*")
panel_3 = Panel("subsystem: Grasshopper DPI")
panel_4 = Panel("subsystem: Display")
panel_5 = Panel("subsystem: Installer")
panel_6 = Panel("2016-06-08")
panel_7 = Panel("Active")
panel_8 = Panel("Unresolved")
panel_9 = Panel("Resolved")
panel_10 = Panel("Ignored")
c_script = CSharpScript()  # -> today
# ---------- c_script: C# ----------
    today = DateTime.Now.Date;
# ---------- end c_script ----------
run = CreateRadioButton(RadioButtonName="Run", RadioButtonGroup="Enabled", InitiallySelected=False)
project = CreateTextBox(Label="Project", DefaultText=panel, UpdateButton=True)
reltarg = CreateTextBox(Label="Release Target", DefaultText="5.3", UpdateButton=True)
filter = CreateTextBox(Label="Filter", UpdateButton=True)
days = CreateTextBox(Label="Days", DefaultText="-30", UpdateButton=True)
no_run = CreateRadioButton(RadioButtonName="Don't Run", RadioButtonGroup="Enabled", InitiallySelected=False)
values = ValueListener(Elements=run, SomeProperty=True)  # -> Values, Indices
values_2 = ValueListener(Elements=project, SomeProperty=True)  # -> Values, Indices
values_3 = ValueListener(Elements=reltarg, SomeProperty=True)  # -> Values, Indices
values_4 = ValueListener(Elements=filter, SomeProperty=True)  # -> Values, Indices
values_5 = ValueListener(Elements=days, SomeProperty=True)  # -> Values, Indices

# ---- group: Computation
date_range = YTDateRangeComponent(Date=c_script, Days=values_5.Values)
youtrack_query = YTQuery(Run=values.Values, Project=values_2.Values, ReleaseTarget=values_3.Values, Search=values_4.Values)  # -> Query, Issues
rev = ReverseList(List=date_range)
as_of = YTAsOf(Issues=youtrack_query.Issues, Timestamp=rev)  # -> Count, Issues
statesummary = YTStateSummaryComponent(Issues=as_of.Issues, States=[panel_8, panel_9, panel_10])  # -> States, Values, Output

# ---- group: Web Server
panel_11 = Panel("""<!DOCTYPE html>
<meta charset="utf-8">
<script>
var graph_width = 60;
var graph_height = 40;
var data_file = "data.csv"

</script>
<style>

body {
  font: 10px sans-serif;
}

.axis path,
.axis line {
  fill: none;
  stroke: #000;
  shape-rendering: crispEdges;
}

.axis {
  font-size: 8pt;
}

.x.axis path {
 /* display: none; */
}

.area.unresolved {
  fill: rgb(200,200,255);
}
.line.unresolved {
  fill: none;
  stroke: #f00;
  stroke-width: 2px;
}

.area.resolved {
  fill: rgb(255,200,200);
}
.line.resolved {
  fill: none;
  stroke: #00f;
  stroke-width: 2px;
}

.line {
  fill: none;
  stroke: #000;
  stroke-width: 2px;
/*  stroke-dasharray: 5, 5;
}

</style>
<body>
<div id='text'></div>
<script src="https://code.jquery.com/jquery-2.2.4.min.js"></script>
<script src="https://d3js.org/d3.v3.min.js" charset="utf-8"></script>
<script>

var margin = {top: 5, right: 30, bottom: 5, left: -2},
    width = graph_width + margin.left + margin.right,
    height = graph_height + margin.top + margin.bottom;

var parseDate = d3.time.format("%Y%m%d").parse;

var x = d3.scale.linear()
    .range([0, width]);

var y = d3.scale.linear()
    .range([height, 0]);

var xAxis = d3.svg.axis()
    .scale(x)
    .orient("bottom");

// TODO: make line out of "ignored" issues (currently an average)
//var line = d3.svg.area()
//    .interpolate("basis")
//    .x(function(d) { return x(d.date); })
//    .y(function(d) { return y((d["resolved"] + d["unresolved"]) * 0.5); });

var line = d3.svg.area().x(function(d) { 
  return x(d.date); 
  })
  .y(function(d) { return 0; });

var area_unresolved = d3.svg.area()
    .interpolate("linear")
    .x(function(d) { 
      return x(d.date); 
      })
    .y0(height)
    .y1(function(d) { 
      return y(d["unresolved"]); 
      });

var line_unresolved = d3.svg.line()
    .x(function(d) { return x(d.date); })
    .y(function(d) { return y(d["unresolved"]); });

var area_resolved = d3.svg.area()
    .interpolate("linear")
    .x(function(d) { return x(d.date); })
    .y0(0)
    .y1(function(d) { return y(d["resolved"]); });

var line_resolved = d3.svg.line()
    .x(function(d) { return x(d.date); })
    .y(function(d) { return y(d["resolved"]); });


var svg = d3.select("body").append("svg")
    .attr("width", width + margin.left + margin.right)
    .attr("height", height + margin.top + margin.bottom)
  .append("g")
    .attr("transform", "translate(" + margin.left + "," + margin.top + ")");

function tickFormatter(d) {
  return Math.abs(d);
}

d3.csv(data_file, function(error, data) {
  if (error) throw error;


  var i = 1;
  data.forEach(function(d) {
    d["date"] = i++;
    d["ignored"] = +d["Ignored"];
    d["unresolved"]= +d["Unresolved"];
    d["resolved"] = -d["Resolved"];
  });

  // $('#text').html(len(data));

  x.domain(d3.extent(data, function(d) { return d["date"]; }));

  y.domain([
    d3.min(data, function(d) { return Math.min(d["resolved"], d["unresolved"]); }),
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""")
handler = WebHandlerComponent(Path="/", Content=panel_11)
handler_2 = WebHandlerComponent(Path="/data.csv", Content=statesummary.Output)
webserver = WebServerComponent(Port="8087", Handlers=[handler, handler_2])

# ----
query = CreateLabel(LabelText=youtrack_query.Query, LabelSize=12, Justification=0)

# ---- group: Display
len = TextLength(Text=statesummary.Output)
dates = Dates(A=date_range)  # -> T, T_2
bool = Boolean(len)
browser = CreateBrowser(URL=webserver, Width=200, Height=100)
launchwin = LaunchWindow(Show=True, Name="YouTrack History", Width=370, Height=400, ChildStatus=0, EnableHorizScroll=False)
concat = Concatenate(FragmentD="Data shown for ", FragmentA=dates.T, FragmentB=" through ", FragmentC=dates.T_2)
date_range_2 = CreateLabel(LabelText=concat, LabelSize=12, Justification=0)
addelems = AddElements(Window=launchwin, Elements=flatten([browser, project, reltarg, filter, days, run, no_run, query, date_range_2]))  # -> AddedElements, ElementNames
setbrowser = SetBrowser(Browser=browser, Refresh=bool)

# ==== cluster Dates
A = ClusterInput()
long = LongestList(ListA=A, PaddingMode=2)  # -> ListA, ListB
rev = ReverseList(List=long.ListA)
subset = SubList(List=rev, Domain=Domain(0, 0), Wrap=True)  # -> List, Index
subset_2 = SubList(List=long.ListA, Domain=Domain(0, 0), Wrap=True)  # -> List, Index
ddate = DeconstructDate(Date=subset.List)  # -> Year, Month, Day, Hour, Minute, Second
ddate_2 = DeconstructDate(Date=subset_2.List)  # -> Year, Month, Day, Hour, Minute, Second
format = Format(Format="{0}-{1}-{2}", Culture=127, Data0=ddate.Year, Data1=ddate.Month, Data2=ddate.Day)
format_2 = Format(Format="{0}-{1}-{2}", Culture=127, Data0=ddate_2.Year, Data1=ddate_2.Month, Data2=ddate_2.Day)
T = ClusterOutput(format)
T_2 = ClusterOutput(format_2)
